# Grasshopper definition Evacuation.gh (Grasshopper 1.0.9)

crv = Curve(<curve referenced from the Rhino model>)
crv_2 = Curve([<curve referenced from the Rhino model> x3])
crv_3 = Curve([<curve referenced from the Rhino model> x2])
py3 = Python3Script(boundary_crv=crv, obstacle_crvs=crv_2, exit=crv_3)  # -> out, a, b, c; inputs boundary_crv: list of Curve, obstacle_crvs: list of Curve, exit: list of Curve
# ---------- py3: Python ----------
# -*- coding: utf-8 -*-

# 安装了 jupedsim, pedpy, shapely
import Rhino.Geometry as rg
from shapely.geometry import Polygon
import shapely
import jupedsim as jps
import pedpy

# 初始化输出变量
agent_points = []
info = []


# --- 核心功能封装在函数中，以便通过布尔值触发 ---
def run_simulation(boundary, obstacles, journeys, agents_n):
    
    output_log = []
    output_points = []

    # =================================================================
    # 1. 将Rhino/GH曲线转换为Shapely多边形
    # =================================================================
    
    def curve_to_2d_points(crv):
        """辅助函数: 将一条Rhino曲线转换为2D点列表"""
        res, polyline = crv.TryGetPolyline()
        if not res:
            return None
        return [(pt.X, pt.Y) for pt in polyline]

    # --- 处理边界和障碍物 ---
    boundary_pts_2d = curve_to_2d_points(boundary)
    obstacles_pts_2d = [curve_to_2d_points(obs) for obs in obstacles]

    shapely_area = Polygon(boundary_pts_2d)
    shapely_obstacles = [Polygon(obs) for obs in obstacles_pts_2d]

    all_obstacles = shapely.unary_union(shapely_obstacles)
    walkable_polygon = shapely.difference(shapely_area, all_obstacles)
    walkable_area = pedpy.WalkableArea(walkable_polygon)
    output_log.append("1. 可行走区域(WalkableArea)已创建。")

    # --- 处理行程区域(Journeys/Exits) ---
    journey_polygons_2d = [Polygon(curve_to_2d_points(crv)) for crv in journeys]
    
    # 根据Office-test1.ipynb的逻辑: 
    # 第一个是入口(Ingress), 后两个是出口(Egress)
    ingress_area = journey_polygons_2d[0]
    egress_areas = journey_polygons_2d[1:]
    
    output_log.append("2. 入口(Ingress)和出口(Egress)区域已定义。")

    # =================================================================
    # 2. 设置并运行Jupedsim模拟
    # =================================================================
    
    # --- 创建行程(Journey) ---
    # 定义从入口区域到两个出口区域的路径
    journey = jps.Journey(
        ingress_area=ingress_area,
        egress_areas=egress_areas
    )
    
    # --- 初始化模拟 ---
    simulation = jps.Simulation(
        model=jps.CollisionFreeSpeedModel(
            static_obstacle_avoidance_distance=0.1,
            agent_reaction_time=0.4,
        ),
        geometry=walkable_area.polygon,
        journeys=[(journey, agents_n)], # 将行程和代理数量关联
    )
    output_log.append(f"3. 模拟已初始化，包含 {agents_n} 个代理。")

    # --- 运行模拟并收集轨迹 ---
    output_log.append("4. 开始运行模拟...")
    trajectory_data = pedpy.TrajectoryData(
        data=simulation.iterate_until_empty(),
        frame_rate=simulation.model.simulation_time_step
    )
    output_log.append("5. 模拟完成！")
    
    # --- 提取轨迹点用于GH可视化 ---
    if not trajectory_data.data.empty:
        traj_df = trajectory_data.data
        for index, row in traj_df.iterrows():
            output_points.append(rg.Point3d(row['x'], row['y'], 0))
    
    return "\n".join(output_log), output_points


# =================================================================
# Grasshopper组件的主执行逻辑
# =================================================================

# 只有当布尔开关为True时才运行模拟
if run_sim and boundary_crv and obstacle_crvs and journey_crvs:
    if len(journey_crvs) != 3:
        info = "错误: 'journey_crvs'输入需要正好3条曲线。"
    else:
        # 调用核心函数
        info, agent_points = run_simulation(
            boundary_crv, 
            obstacle_crvs, 
            journey_crvs, 
            num_agents
        )
else:
    info = "将 'run_sim' 设置为 True 以启动模拟。"


# --- 将结果赋给输出端口 ---
# 'a' 端口在组件外被重命名为 'agent_points'
a = agent_points
# ---------- end py3 ----------
